# Grasshopper definition UI SCRIPT.gh (Grasshopper 1.0.8)
# Copyright: http://www.robertbird.com/end-user-license-agreement/
# plug-ins: Human UI, Pufferfish, DKUI.Components, LunchBox

# ---- group: OP_
# Template (please leave as is)
manual_colour_all_groups = Button()
enable_user_object_sync = BooleanToggle(True)
auto_group_colours = BooleanToggle(True)
# Note:- Requirements!!!!!!!
# RBG Standard ONLY
# If not RBG Standard talk with CD Staff
rir_rinoinsiderevit = ColourSwatch(SwatchColor=RGB(61, 89, 161))
depr_depreciated = ColourSwatch(SwatchColor=RGB(247, 247, 242))
op_operation = ColourSwatch(SwatchColor=RGB(186, 153, 247))
rev_revision = ColourSwatch(SwatchColor=RGB(255, 117, 126))
out_output = ColourSwatch(SwatchColor=RGB(79, 214, 189))
g_geometry = ColourSwatch(SwatchColor=RGB(196, 232, 142))
in_input = ColourSwatch(SwatchColor=RGB(125, 207, 255))
v_visual = ColourSwatch(SwatchColor=RGB(255, 156, 99))
d_data = ColourSwatch(SwatchColor=RGB(255, 199, 120))
group_auto_colours = GroupAutoColours(
    Enable=auto_group_colours,
    Run=manual_colour_all_groups,
    Colours=[in_input, op_operation, d_data, g_geometry, out_output, v_visual, rev_revision, depr_depreciated, rir_rinoinsiderevit])  # -> Log; inputs Enable: Boolean, Run: Boolean, Colours: list of Color
# ---------- group_auto_colours: C# ----------
// Grasshopper Script Instance
#region Usings
using System;
using System.Linq;
using System.Collections;
using System.Collections.Generic;
using System.Drawing;
using System.Text;
using System.Reflection;

using Rhino;
using Rhino.Geometry;

using Grasshopper;
using Grasshopper.Kernel;
using Grasshopper.Kernel.Data;
using Grasshopper.Kernel.Types;
#endregion

public class Script_Instance : GH_ScriptInstance
{
    #region Notes
    /* 
      Members:
        RhinoDoc RhinoDocument
        GH_Document GrasshopperDocument
        IGH_Component Component
        int Iteration

      Methods (Virtual & overridable):
        Print(string text)
        Print(string format, params object[] args)
        Reflect(object obj)
        Reflect(object obj, string method_name)
    */
    #endregion

    private void RunScript(bool Enable, bool Run, List<Color> Colours)
    {

        IList<IGH_DocumentObject> docObjects = Grasshopper.Instances.ActiveCanvas.Document.Objects;
        foreach (var docobj in docObjects)
        {
            Print(docobj.GetType().ToString());
        }

        // Component setup
        Component.Name = "Group Auto Colours";
        Component.Description = "Set up event handlers to auto color groups based on name prefix e.g. 'IN_' and 'OUT_'.\n"
        + "\n\n"
        + "Adpated from original code prepared by Mathias Sønderskov Schaltz 2022 under MIT license.\n"
        + "Contact: mitchell.tesch@robertbird.com.au";
        Component.Params.Input[0].Description = "Enable?";
        Component.Params.Input[1].Description = "Run it once and color all existing groups?";
        Component.Params.Input[2].Description = "Colour groups input as a list of colour swatches named in the following format: PREFIX_description";

        msg.Clear();
        this.Component.Message = "id: " + id.ToString();

        if (Enable)
        {
        msg.AppendFormat("Set up events handlers on ID {0}\n", id);
        SetupColourDict();
        SetEventHandlers();
        }
        else
        {
        RemoveEventHandlers();
        }

        if (Run)
        {
        foreach(Grasshopper.Kernel.Special.GH_Group ghGroup in Grasshopper.Instances.ActiveCanvas.Document.Objects.OfType<Grasshopper.Kernel.Special.GH_Group>())
        {
            ColourGroup(ghGroup, null);
        }
        }

        Print(msg.ToString());
    }


  public static Random rnd = new Random();
  public int id = rnd.Next(0, 1000);
  StringBuilder msg = new StringBuilder();
  Dictionary<string, System.Drawing.Color> colourDict = new Dictionary<string, System.Drawing.Color>();


  public bool IdExists(int id)
  {
    IList<IGH_DocumentObject> docObjects = Grasshopper.Instances.ActiveCanvas.Document.Objects;
    return docObjects
      .OfType<IGH_Component>()
      .Where(obj => obj.NickName == this.Component.NickName)
      .Where(obj => obj.GetType().ToString() == "RhinoCodePluginGH.Components.CSharpComponent")
      .Where(obj => obj.Message == "id: " + id.ToString()).Any();
  }

  /// <summary>
  /// Create group colour dictionary from inpur colour swatches.
  /// </summary>
  /// <returns></returns>
  public void SetupColourDict()
  {
    colourDict.Clear();
    IList<IGH_Param> colourSources = this.Component.Params.Input[2].Sources;
    if (colourSources.Count == 0)
    {
      throw new Exception("Error: No colour swatches provided, nput named colour swatches.");
    }

    foreach(IGH_Param source in colourSources)
    {
      if (source is Grasshopper.Kernel.Special.GH_ColourSwatch)
      {
        string colourNickname = source.NickName.Split('_')[0].Trim() + "_";
        if(!colourDict.ContainsKey(colourNickname))
        {
          Grasshopper.Kernel.Special.GH_ColourSwatch swatch = (Grasshopper.Kernel.Special.GH_ColourSwatch) source;
          colourDict.Add(colourNickname, swatch.SwatchColour);
        }
        else
        {
          throw new Exception("Error: Multiple swatches using the same name detected, check naming.");
        }
      }
      else
      {
        throw new Exception(String.Format("Error: {0} detected, parameter only accepts colour swatches.", source.Type.ToString()));
      }
    }

    msg.AppendFormat("Group colour dictionary created with {0} colours\n", colourDict.Count);
    foreach(var pairs in colourDict)
    {
      msg.AppendFormat("{0} -> {1}\n", ("\"" + pairs.Key + "\"").PadRight(5 + colourDict.Keys.Select(k => k.Length).Max()), pairs.Value);
    }
  }

  /// <summary>
  /// Set event handlers
  /// </summary>
  /// <returns></returns>
  public void SetEventHandlers()
  {
    // Always remove events first to avoid duplicates
    GrasshopperDocument.ObjectsAdded -= OnObjectsAdded;
    GrasshopperDocument.ObjectsDeleted -= OnObjectsRemoved;
    GrasshopperDocument.ObjectsDeleted -= OnDeleteThisComponent;

    // Attach events
    GrasshopperDocument.ObjectsAdded += OnObjectsAdded;
    GrasshopperDocument.ObjectsDeleted += OnObjectsRemoved;
    GrasshopperDocument.ObjectsDeleted += OnDeleteThisComponent;

    foreach(Grasshopper.Kernel.Special.GH_Group ghGroup in GrasshopperDocument.Objects.OfType<Grasshopper.Kernel.Special.GH_Group>())
    {
      ghGroup.ObjectChanged -= ColourGroup;
      ghGroup.ObjectChanged += ColourGroup;
    }
    msg.AppendFormat("Added the event handlers on {0} existing groups and on future created groups\n", GrasshopperDocument.Objects.OfType<Grasshopper.Kernel.Special.GH_Group>().Count());
  }

  /// <summary>
  /// Remove event handlers
  /// </summary>
  /// <returns></returns>
  public void RemoveEventHandlers()
  {
    GrasshopperDocument.ObjectsAdded -= OnObjectsAdded;
    GrasshopperDocument.ObjectsDeleted -= OnObjectsRemoved;

    foreach(Grasshopper.Kernel.Special.GH_Group ghGroup in GrasshopperDocument.Objects.OfType<Grasshopper.Kernel.Special.GH_Group>())
    {
      ghGroup.ObjectChanged -= ColourGroup;
    }
    msg.AppendFormat("Removed event handlers on document and on {0} groups\n", GrasshopperDocument.Objects.OfType<Grasshopper.Kernel.Special.GH_Group>().Count());
  }


  public void OnObjectsAdded(object sender, GH_DocObjectEventArgs e)
  {
    foreach (Grasshopper.Kernel.Special.GH_Group ghGroup in e.Objects.OfType<Grasshopper.Kernel.Special.GH_Group>())
    {
      ghGroup.ObjectChanged -= ColourGroup;
      ghGroup.ObjectChanged += ColourGroup;
    }
  }


  public void OnObjectsRemoved(object sender, GH_DocObjectEventArgs e)
  {
    foreach (Grasshopper.Kernel.Special.GH_Group ghGroup in e.Objects.OfType<Grasshopper.Kernel.Special.GH_Group>())
    {
      ghGroup.ObjectChanged -= ColourGroup;
    }
  }

  /// <summary>
  /// Colour group based on name
  /// </summary>
  /// <param name="sender"></param>
  /// <param name="e"></param>
  /// <returns></returns>
  public void ColourGroup(object sender, EventArgs e)
  {
    if (!IdExists(id))
    {
      RemoveEventHandlers();
      return;
    }

    Grasshopper.Kernel.Special.GH_Group ghGroup = sender as Grasshopper.Kernel.Special.GH_Group;
    //not type GH_Group
    if (ghGroup == null) return;

    string[] nameParts = ghGroup.NickName.Split('_');
    // group not of PREFIX_description naming convention
    if (nameParts.Length <= 1)
      return;

    string prefix = ghGroup.NickName.Split('_')[0].Trim() + '_';
    msg.Append("prefix " + prefix + "\n");
    if (colourDict.ContainsKey(prefix))
    {
      ghGroup.Colour = colourDict[prefix];
    }
  }

  public void OnDeleteThisComponent(object sender, GH_DocObjectEventArgs e)
  {
    if (e.Objects.OfType<Grasshopper.Kernel.GH_Component>().Where(o => o.NickName == this.Component.NickName).Any())
    {
      RemoveEventHandlers();
    }
  }

}
# ---------- end group_auto_colours ----------
user_object_sync = UserObjectSync(Enable=enable_user_object_sync)  # -> Log; inputs Enable: Boolean
# ---------- user_object_sync: C# ----------
// Grasshopper Script Instance
#region Usings
using System;
using System.IO;
using System.Linq;
using System.Collections;
using System.Collections.Generic;
using System.Drawing;
using System.Security.Cryptography;
using System.Threading.Tasks;

using Rhino;
using Rhino.Geometry;

using Grasshopper;
using Grasshopper.Kernel;
using Grasshopper.Kernel.Data;
using Grasshopper.Kernel.Types;
#endregion

public class Script_Instance : GH_ScriptInstance
{
    #region Notes
    /* 
      Members:
        RhinoDoc RhinoDocument
        GH_Document GrasshopperDocument
        IGH_Component Component
        int Iteration

      Methods (Virtual & overridable):
        Print(string text)
        Print(string format, params object[] args)
        Reflect(object obj)
        Reflect(object obj, string method_name)
    */
    #endregion

    const string SpOrgName = "Surbana Jurong Private Limited";
    const string RbgGhResourceFolder = @"RB OP GP_Robert Bird Group - Production Resources\Software\Grasshopper\Grasshopper\";
    const string KtpGhResourceFolder = @"KTP Digital Team - Production Resources\Software\Grasshopper\Grasshopper\";
    const string SmecGhResourceFolder = @"SMEC_ZA_B+C_STR-SMEC ZA_STR_CD - Production Resources\Software\Grasshopper\Grasshopper\";

    private void RunScript(bool Enable)
    {
        // Component Configuration
        Component.Name = "User Object Sync";
        Component.Description = "Syncronises new shared user objects from the Production Resources to local."
        + "\n\n"
        + "Contact: mitchell.tesch@robertbird.com.au";
        Component.Params.Input[0].Description = "Enable sync?";

        if (!Enable) return;

        string spUserObjectsFolder = "";
        string companyName = Grasshopper.CentralSettings.AuthorCompany;
        switch (companyName)
        {
        case "Robert Bird Group":
            spUserObjectsFolder = RbgGhResourceFolder + "UserObjects";
            break;

        case "KTP":
            spUserObjectsFolder = KtpGhResourceFolder + "UserObjects";
            break;

        case "SMEC":
            spUserObjectsFolder = SmecGhResourceFolder + "UserObjects";
            break;

        default:
            Print(String.Format("Author Company Name (0) not a valid SJ brand. Ensure User Setup Script has been run.", companyName));
            return;
        }

        var ghSharedUserObjectsPath = Path.Combine(sharepointPath, spUserObjectsFolder);

        if (!Directory.Exists(ghSharedUserObjectsPath))
        {
        Print("Error: SharePoint UserObjects Directory not found - check Production Resources syncronisation setup.");
        return;
        }

        SyncUserObjects(ghSharedUserObjectsPath);
    }

  /// <summary>
  /// Location of shared User Objects (RBG Production Resources)
  /// </summary>
  public static string onedriveCommPath = Environment.GetEnvironmentVariable("OneDriveCommercial");
  public static string sharepointPath = Path.GetFullPath(Path.Combine(onedriveCommPath, @"..\", SpOrgName));

  public static string localUserObjectsDir = Grasshopper.Folders.DefaultUserObjectFolder;

  /// <summary>
  /// Function to Sync the required user objects local
  /// </summary>
  /// <returns></returns>
  public void SyncUserObjects(string ghSharedUserObjectsPath)
  {
    var sharedUserObjects = RetrieveSharedUserObjects(ghSharedUserObjectsPath);
    var localUserObjects = RetrieveLocalUserObjects();
    var filesRequired = GetRequiredUserObjects(sharedUserObjects, localUserObjects);
    CopyRequiredUserObjects(filesRequired);
  }

  /// <summary>
  /// Retrieves shared User Objects from shared location
  /// </summary>
  /// <returns></returns>
  public string[] RetrieveSharedUserObjects(string ghSharedUserObjectsPath)
  {
    string[] sharedUserObjects = Directory.GetFiles(ghSharedUserObjectsPath);
    return sharedUserObjects;
  }

  /// <summary>
  /// Retrieves Local User Objects from Local special folder
  /// </summary>
  /// <returns></returns>
  public string[] RetrieveLocalUserObjects()
  {
    string[] localUserObjects = Directory.GetFiles(localUserObjectsDir);
    return localUserObjects;
  }

  /// <summary>
  /// Determine which shared User Objects do not exist locally and hence are required locally
  /// </summary>
  /// <param name="sharedUserObjects"></param>
  /// <param name="localUserObjects"></param>
  /// <returns></returns>
  public List<string> GetRequiredUserObjects(string[] sharedUserObjects, string[] localUserObjects)
  {
    List < string > filesRequired = new List<string>();

    for (int i = 0; i < sharedUserObjects.Length; i++)
    {
      bool isCurrent = false;
      byte[] sharedUserObjectChecksum = GetChecksum(sharedUserObjects[i]);
      for (int j = 0; j < localUserObjects.Length; j++)
      {
        if (sharedUserObjectChecksum.SequenceEqual(GetChecksum(localUserObjects[j])))
        {
          isCurrent = true;
          break;
        }
      }
      if (isCurrent)
      {
        continue;
      }
      filesRequired.Add(sharedUserObjects[i]);
    }
    return filesRequired;
  }

  /// <summary>
  /// Copy the User objects required locally
  /// </summary>
  /// <param name="filesRequired"></param>
  /// <returns></returns>
  public void CopyRequiredUserObjects(List<string> filesRequired)
  {
    Parallel.ForEach(filesRequired, (currentFile) =>
      {
      var fileName = Path.GetFileName(currentFile);
      var newFile = Path.Combine(localUserObjectsDir, fileName);
      try
      {
        File.Copy(currentFile, newFile, true);
      }
      catch (Exception ex)
      {
        Print(ex.Message);
      }
      });
    Print(String.Format("Synced {0} new user objects.", filesRequired.Count));
  }

  /// <summary>
  /// Get file Checksum
  /// </summary>
  /// <param name="filePath"></param>
  /// <returns></returns>
  static byte[] GetChecksum(string filePath)
  {
    using (var stream = new BufferedStream(File.OpenRead(filePath), 1200000))
    {
      SHA256Managed sha = new SHA256Managed();
      byte[] checksum = sha.ComputeHash(stream);
      return checksum;
    }
  }

}
# ---------- end user_object_sync ----------

# ----
# DIY Selectable, Scale-able List
panel = Panel("""L1
L2
L3
L4
L5
L6
L7
L8
L9
L10
L12
L13""")
list_indices = ListIndices(List=panel)
list_length = ListLength(List=list_indices)
duplicate_data = DuplicateData(Data="<option value =\"", Number=list_length, Order=True)
duplicate_data_2 = DuplicateData(Data="\">", Number=list_length, Order=True)
duplicate_data_3 = DuplicateData(Data="</option>", Number=list_length, Order=True)
panel_2 = Panel("""<body>
    <div class="custom-select">
        <select multiple size="5">
            <option value="0">Select a Level:</option>""")
concatenate = Concatenate(Fragment_A=duplicate_data, Fragment_B=list_indices, A=duplicate_data_2, C=panel, B=duplicate_data_3)
panel_3 = Panel("""        </select>
    </div>
</body>""")
text_join = TextJoin(Text=concatenate)
concatenate_2 = Concatenate(Fragment_A=panel_2, Fragment_B=text_join, A=panel_3)  # -> flatten(Result)

# ---- group: V_
# Canvas Customisation
enable_custom_canvas = BooleanToggle(True)
enable_canvas_portal = BooleanToggle(False)
swatch = ColourSwatch(SwatchColor=RGB(255, 255, 255))
swatch_2 = ColourSwatch(SwatchColor=RGB(116, 123, 163))
swatch_3 = ColourSwatch(SwatchColor=RGB(41, 46, 66))
custom_canvas = CustomCanvas(
    Enable=enable_custom_canvas,
    BackgroundColour=swatch,
    GridColour=swatch,
    PanelColour=ColourSwatch(SwatchColor=RGB(255, 199, 120)))  # inputs Enable: Boolean, BackgroundColour: Color, GridColour: Color, PanelColour: Color
# ---------- custom_canvas: C# ----------
// Grasshopper Script Instance
#region Usings
using System;
using System.Linq;
using System.Collections;
using System.Collections.Generic;
using System.Drawing;

using Rhino;
using Rhino.Geometry;

using Grasshopper;
using Grasshopper.Kernel;
using Grasshopper.Kernel.Data;
using Grasshopper.Kernel.Types;
#endregion

public class Script_Instance : GH_ScriptInstance
{
    #region Notes
    /* 
      Members:
        RhinoDoc RhinoDocument
        GH_Document GrasshopperDocument
        IGH_Component Component
        int Iteration

      Methods (Virtual & overridable):
        Print(string text)
        Print(string format, params object[] args)
        Reflect(object obj)
        Reflect(object obj, string method_name)
    */
    #endregion

    private void RunScript(
		bool Enable,
		Color BackgroundColour,
		Color GridColour,
		Color PanelColour)
    {

        Component.Name = "Custom Canvas";
        Component.Description = "Sets colour theme for Grasshopper canvas."
        + "\n\n"
        + "Contact: mitchell.tesch@robertbird.com.au";
        Component.Params.Input[0].Description = "Enable custom canvas?";
        Component.Params.Input[1].Description = "Colour of the Canvas Background.";
        Component.Params.Input[2].Description = "Colour of the Canvas Grid.";
        Component.Params.Input[2].Description = "Colour of Panels.";

        if (Enable)
        {
        Grasshopper.GUI.Canvas.GH_Skin.canvas_grid = System.Drawing.Color.FromArgb(GridColour.ToArgb());
        Grasshopper.GUI.Canvas.GH_Skin.canvas_back = System.Drawing.Color.FromArgb(BackgroundColour.ToArgb());
        Grasshopper.GUI.Canvas.GH_Skin.canvas_edge = System.Drawing.Color.FromArgb(255, 68, 71, 89);
        Grasshopper.GUI.Canvas.GH_Skin.panel_back = System.Drawing.Color.FromArgb(PanelColour.ToArgb());
        Grasshopper.GUI.Canvas.GH_Skin.canvas_shade_size = 0;
        }
        else
        {
        Grasshopper.GUI.Canvas.GH_Skin.canvas_grid = System.Drawing.Color.FromArgb(30, 0, 0, 0);
        Grasshopper.GUI.Canvas.GH_Skin.canvas_back = System.Drawing.Color.FromArgb(255, 212, 208, 200);
        Grasshopper.GUI.Canvas.GH_Skin.canvas_edge = System.Drawing.Color.FromArgb(255, 0, 0, 0);
        Grasshopper.GUI.Canvas.GH_Skin.panel_back = System.Drawing.Color.FromArgb(255, 255, 238, 109);
        Grasshopper.GUI.Canvas.GH_Skin.canvas_shade = System.Drawing.Color.FromArgb(80, 0, 0, 0);
        }
    }
}
# ---------- end custom_canvas ----------
canvas_portal = CanvasPortal(Enable=enable_canvas_portal, Width=Slider(0.5, range=0..1))  # inputs Enable: Boolean, Width: Double
# ---------- canvas_portal: C# ----------
// Grasshopper Script Instance
#region Usings
using System;
using System.Linq;
using System.Collections;
using System.Collections.Generic;
using System.Drawing;

using Rhino;
using Rhino.Geometry;

using Grasshopper;
using Grasshopper.Kernel;
using Grasshopper.Kernel.Data;
using Grasshopper.Kernel.Types;
#endregion

public class Script_Instance : GH_ScriptInstance
{
    #region Notes
    /* 
      Members:
        RhinoDoc RhinoDocument
        GH_Document GrasshopperDocument
        IGH_Component Component
        int Iteration

      Methods (Virtual & overridable):
        Print(string text)
        Print(string format, params object[] args)
        Reflect(object obj)
        Reflect(object obj, string method_name)
    */
    #endregion
    
    private bool portalState = false;
    public double portalWidth;

    private void RunScript(bool Enable, double Width)
    {
        Component.Name = "Canvas Portal";
        Component.Description = "Greats a portal through the Grasshopper Canvas."
        + "\n\n"
        + "Contact: mitchell.tesch@robertbird.com.au";
        Component.Params.Input[0].Description = "Enable Canvas Portal?";
        Component.Params.Input[1].Description = "Width of Portal.";

        if (Enable == portalState) return;

        portalState = Enable;
        portalWidth = Width;

        if (Enable)
        {
        Instances.ActiveCanvas.CanvasPaintBackground += PaintHandler;
        }
        else
        {
        Instances.ActiveCanvas.CanvasPaintBackground -= PaintHandler;
        }
    }


    private void PaintHandler(Grasshopper.GUI.Canvas.GH_Canvas sender)
    {
        sender.Graphics.ResetTransform();
        double width = sender.Width * portalWidth;
        using (Pen pen = new Pen(Color.FromArgb(33, 219, 219), 10))
        using (SolidBrush brush = new SolidBrush(Color.Snow))
        {
        Rectangle rect = GH_Convert.ToRectangle(new Rectangle(5, 5, (int) width, sender.Height - 10));
        sender.Graphics.DrawRectangle(pen, rect);
        sender.Graphics.FillRectangle(brush, rect);
        }

        sender.Viewport.ApplyProjection(sender.Graphics);
        System.Windows.Forms.Form form = Grasshopper.Instances.DocumentEditor;
        form.TransparencyKey = Color.Snow;
        form.Show();
    }
}
# ---------- end canvas_portal ----------

# ----
fill_basic_document_properties = Button()

# ----
# Graph Information
# Grasshopper File: C:\Users\mitchell.tesch\Surbana Jurong Private Limited\RB OP GP_Robert Bird Group - Production Resources\Software\Grasshopper\Grasshopper\Template\GH-T-001_GrasshopperTemplate_R8.gh
# Description: (Please give a description of the purpose of this Graph with enough detail anyone reading this will understand what it does)
# External Dependencies: Please add all associated files that accompany or are required by this Graph. For example: .csv, .xlsx, .rvt, .ifc.
# Revision History: P001 - Blah Added - Mitchell Tesch - 31/07/2022
# Project Info: XXXX_Project Name - Division - Office
# Limitations and Other Notes: (Please add any Warnings or conditions where this script will not work)
trained_user_s = Panel("")
author_s = Panel("Mitchell.Tesch")

tool_name = Panel("GH-T-001_GrasshopperTemplate_R8")
fill_basic_document_information = FillBasicDocumentInformation(Run=fill_basic_document_properties)  # inputs Run: Boolean
# ---------- fill_basic_document_information: C# ----------
// Grasshopper Script Instance
#region Usings
using System;
using System.Linq;
using System.Collections;
using System.Collections.Generic;
using System.Drawing;

using Rhino;
using Rhino.Geometry;

using Grasshopper;
using Grasshopper.Kernel;
using Grasshopper.Kernel.Data;
using Grasshopper.Kernel.Types;
using Grasshopper.Kernel.Special;
#endregion

public class Script_Instance : GH_ScriptInstance
{
    #region Notes
    /* 
      Members:
        RhinoDoc RhinoDocument
        GH_Document GrasshopperDocument
        IGH_Component Component
        int Iteration

      Methods (Virtual & overridable):
        Print(string text)
        Print(string format, params object[] args)
        Reflect(object obj)
        Reflect(object obj, string method_name)
    */
    #endregion

    private void RunScript(bool Run)
    {
        Component.Name = "Fill Basic Document Information";
        Component.Description = "Fills basic document information based on user and save location."
        + "\n\n"
        + "Contact: mitchell.tesch@robertbird.com.au";
        Component.Params.Input[0].Description = "Run?";

        if (!Run) return;

        string fileName = GrasshopperDocument.DisplayName;
        if (GrasshopperDocument.IsModified)
        {
        fileName = fileName.TrimEnd('*');
        }

        string filePath = GrasshopperDocument.FilePath;
        string authorName = Grasshopper.CentralSettings.AuthorName;

        WritePanel("Tool Name", fileName);
        WritePanel("Grasshopper File", filePath);
        WritePanel("Author(s)", authorName);
    }

    private void WritePanel(string panelNickName, string text)
    {
        foreach (var obj in GrasshopperDocument.Objects)
        {
        if (obj is GH_Panel)
        {
            GH_Panel panel = (GH_Panel) obj;
            if (panel.NickName == panelNickName)
            {
            panel.UserText = text;
            panel.ExpireSolution(true);
            }
        }
        }
    }
}
# ---------- end fill_basic_document_information ----------
# Used External Plug-ins: Rhino.Inside for Autodesk Revit 1.29.9186+b390d404822365c7318a235f699cae8b3b8f6c23
# CORE.Toolbox.Grasshopper 2.0.8.0
# eleFront 5.1.9-beta
# Human 1.3.1
# treesloth01
detect_plug_ins_used = Button()
detect_plug_ins_used_2 = DetectPlugInsUsed(Run=detect_plug_ins_used)  # inputs Run: Boolean
# ---------- detect_plug_ins_used_2: C# ----------
// Grasshopper Script Instance
#region Usings
using System;
using System.Linq;
using System.Collections;
using System.Collections.Generic;
using System.Drawing;

using Rhino;
using Rhino.Geometry;

using Grasshopper;
using Grasshopper.Kernel;
using Grasshopper.Kernel.Data;
using Grasshopper.Kernel.Types;
using Grasshopper.Kernel.Special;
#endregion

public class Script_Instance : GH_ScriptInstance
{
    #region Notes
    /* 
      Members:
        RhinoDoc RhinoDocument
        GH_Document GrasshopperDocument
        IGH_Component Component
        int Iteration

      Methods (Virtual & overridable):
        Print(string text)
        Print(string format, params object[] args)
        Reflect(object obj)
        Reflect(object obj, string method_name)
    */
    #endregion

    private void RunScript(bool Run)
    {
        Component.Name = "Detect Plug-ins Used";
        Component.Description = "Fills used external plug-ins information based on used components."
        + "\n\n"
        + "Contact: mitchell.tesch@robertbird.com.au";
        Component.Params.Input[0].Description = "Run?";

        if (!Run) return;

        var libraries = Libraries();

        List<string> addons = new List<string>();
        foreach (KeyValuePair<Guid, GH_AssemblyInfo> pair in libraries.Item2)
        {
        var lib = pair.Value;
        if (!string.IsNullOrEmpty(lib.Name))
        {
            addons.Add(String.Format("{0} {1}", lib.Name, lib.Version));
        }
        }

        string addons_str = string.Join("\n", addons);

        if (string.IsNullOrEmpty(addons_str))
        {
        addons_str = "No external plug-ins detected (button to left to update)";
        }

        WritePanel("Used External Plug-ins", addons_str);

    }

    public Tuple<Dictionary<Guid, GH_AssemblyInfo>, Dictionary<Guid, GH_AssemblyInfo>> Libraries()
    {
        Dictionary<Guid, GH_AssemblyInfo> coreLibraries = new Dictionary<Guid, GH_AssemblyInfo>();
        Dictionary<Guid, GH_AssemblyInfo> addonLibraries = new Dictionary<Guid, GH_AssemblyInfo>();
        Dictionary<Guid, string> objids = new Dictionary<Guid, string>();

        GH_ComponentServer server = Grasshopper.Instances.ComponentServer;

        foreach (IGH_DocumentObject obj in GrasshopperDocument.Objects)
        {
        Guid objId = obj.ComponentGuid;

        if (objids.ContainsKey(objId))
            continue;

        objids[objId] = "";

        GH_AssemblyInfo lib = server.FindAssemblyByObject(obj);

        if (lib == null)
            continue;

        if (coreLibraries.ContainsKey(lib.Id) || addonLibraries.ContainsKey(lib.Id))
            continue;

        if (lib.IsCoreLibrary)
            coreLibraries[lib.Id] = lib;
        else
            addonLibraries[lib.Id] = lib;
        }

        return Tuple.Create(coreLibraries, addonLibraries);
    }


    private void WritePanel(string panelNickName, string text)
    {
        foreach (var obj in GrasshopperDocument.Objects)
        {
        if (obj is GH_Panel)
        {
            GH_Panel panel = (GH_Panel) obj;
            if (panel.NickName == panelNickName)
            {
            panel.UserText = text;
            panel.ExpireSolution(true);
            }
        }
        }
    }

}
# ---------- end detect_plug_ins_used_2 ----------

# ---- group: IN_
# Group Colour Legend
panel_4 = Panel("Input")

# ---- group: D_
panel_5 = Panel("Data")

# ----
# DIY Toggle Button
panel_6 = Panel("""<label class="switch">
  <input type="checkbox">
  <span class="slider"></span>
</label>""")

# ---- group: OP_
panel_7 = Panel("Operation")

# ---- group: G_
panel_8 = Panel("Geometry")

# ----
boolean = Boolean(True)
launch_window = LaunchWindow(Show=boolean, Name="RBG Test UI", Width="600", Height=400, ChildStatus=0, EnableHorizScroll=False)
boolean_2 = Boolean(True)
set_window_properties = SetWindowProperties(Window=launch_window, Theme=boolean_2, AccentColor="Blue", ShowTitleBar=True, ScaleFactor=1)

cluster = Cluster(header_text="HEADER TEXT, THIS IS SOME")
create_button = CreateButton(ButtonName="THIS BUTTON DOES TASK 'X'", ButtonStyle=0)
create_button_2 = CreateButton(ButtonName="THIS BUTTON DOES TASK 'Z'", ButtonStyle=0)
value_listener = ValueListener(Elements=create_button, SomeProperty=True)  # -> Values, Indices
value_listener_2 = ValueListener(Elements=create_button_2, SomeProperty=True)  # -> Values, Indices
entwine = Entwine(Branch00=cluster, Branch01=create_button, Branch02=create_button_2, FlattenInputs=True)
panel_9 = Panel(value_listener.Values)
panel_10 = Panel(value_listener_2.Values)

panel_11 = Panel("""ITEM 1
ITEM 2
ITEM 3
ITEM 394""")
cluster_2 = Cluster(header_text="THIS IS EVEN MORE HEADER TEXT")
create_pulldown_menu = CreatePulldownMenu(ListItems=panel_11, showLabel=True)
create_button_3 = CreateButton(ButtonName="RUN TASK", ButtonStyle=0)
entwine_2 = Entwine(Branch00=cluster_2, Branch01=create_pulldown_menu, Branch02=create_button_3, FlattenInputs=True)
value_listener_3 = ValueListener(Elements=create_pulldown_menu, SomeProperty=True)  # -> Values, Indices
value_listener_4 = ValueListener(Elements=create_button_3, SomeProperty=True)  # -> Values, Indices
panel_12 = Panel(value_listener_3.Values)
panel_13 = Panel(value_listener_4.Values)

panel_14 = Panel("""L1
L2
L3
L4
L5
L6
L7
L8
L9""")

# ---- group: OUT_
panel_15 = Panel("Output")

# ----
cluster_3 = Cluster(header_text="THIS IS SOME HEADER TEXT")
create_list_box = CreateListBox(ListItems=panel_14, SelectedIndex=0, Height=100)

# ---- group: V_
panel_16 = Panel("Visual")

# ----
create_toggle = CreateToggle(Default=False)

# ---- group: REV_
panel_17 = Panel("Revision")

# ---- group: DEPR_
panel_18 = Panel("Depreciated")

# ----
entwine_3 = Entwine(Branch00=cluster_3, Branch01=create_list_box, Branch02=create_toggle, FlattenInputs=True)
value_listener_5 = ValueListener(Elements=create_list_box, SomeProperty=True)  # -> Values, Indices
value_listener_6 = ValueListener(Elements=create_toggle, SomeProperty=True)  # -> Values, Indices
adjust_element_positioning = AdjustElementPositioning(ElementsToAdjust=create_toggle, AbsolutePositioning=False, HorizontalAlignment="1")
file_path = FilePath("C:\Users\Harley.Trappitt\OneDrive - Surbana Jurong Private Limited\Documents\GH\icon.png")
dk_b64_encode_icon = DKB64EncodeIcon(File_path=file_path)
dk_h2_text = DKH2Text(Text="THIS IS SOME HEADER TEXT")
dk_h2_text_2 = DKH2Text(Text="SOME HEADER TEXT, THIS IS")
dk_h2_text_3 = DKH2Text(Text="THIS IS ALSO SOME HEADER TEXT")

# ---- group: RIR_
panel_19 = Panel("RhinoInsideRevit")

# ----
panel_20 = Panel(value_listener_5.Values)
panel_21 = Panel(value_listener_6.Values)
merge = Merge(Data1=dk_h2_text, Data2=concatenate_2, Data3=panel_6)
image_resource = ImageResource("C:\Users\Harley.Trappitt\OneDrive - Surbana Jurong Private Limited\Documents\GH\icons8-1-64.png")
image_resource_2 = ImageResource("C:\Users\Harley.Trappitt\OneDrive - Surbana Jurong Private Limited\Documents\GH\icons8-2-64.png")
image_resource_3 = ImageResource("C:\Users\Harley.Trappitt\OneDrive - Surbana Jurong Private Limited\Documents\GH\icons8-3-64.png")
file_path_2 = FilePath("C:\Users\Harley.Trappitt\OneDrive - Surbana Jurong Private Limited\Documents\GH\icons8-1-64.png")
file_path_3 = FilePath("C:\Users\Harley.Trappitt\OneDrive - Surbana Jurong Private Limited\Documents\GH\icons8-2-64.png")
file_path_4 = FilePath("C:\Users\Harley.Trappitt\OneDrive - Surbana Jurong Private Limited\Documents\GH\icons8-3-64.png")
entwine_4 = Entwine(Branch00=image_resource, Branch01=image_resource_2, Branch02=image_resource_3, FlattenInputs=True)  # -> flatten(Result)
# Tab 1
# Tab 2
# Tab 3
tabbed_view = TabbedView(TabIconSource=entwine_4, Tab0=flatten(entwine_3), Tab1=flatten(entwine_2), Tab2=flatten(entwine))
colour = Colour(RGB(94, 94, 94))

# ----
# Additional CSS for Toggle Button styling
panel_22 = Panel("""/* The switch - the box around the slider */
.switch {
  position: relative;
display: flex;
justify-content: center;
  width: 60px;
  height: 34px;
}

/* Hide default HTML checkbox */
.switch input {
  opacity: 0;
  width: 0;
  height: 0;
}

/* The slider */
.slider {
  position: absolute;
  cursor: pointer;
  top: 0;
  left: 0;
  right: 0;
  bottom: 0;
  background-color: #ccc;
  -webkit-transition: .4s;
  transition: .4s;
}

.slider:before {
  position: absolute;
  content: "";
  height: 26px;
  width: 26px;
  left: 4px;
  bottom: 4px;
  background-color: white;
  -webkit-transition: .4s;
  transition: .4s;
}

input:checked + .slider {
  background-color: #2196F3;
}

input:focus + .slider {
  box-shadow: 0 0 1px #2196F3;
}

input:checked + .slider:before {
  -webkit-transform: translateX(26px);
  -ms-transform: translateX(26px);
  transform: translateX(26px);
}

/* Rounded sliders */
.slider.round {
  border-radius: 34px;
}

.slider.round:before {
  border-radius: 50%;
}
select {
width: 100%;
}""")

adjust_element_appearance = AdjustElementAppearance(ElementsToAdjust=tabbed_view, Background=colour)
add_elements = AddElements(Window=launch_window, Elements=flatten(tabbed_view), DoVLChecking=True)  # -> AddedElements, ElementNames
file_path_5 = FilePath("C:\Users\Harley.Trappitt\OneDrive - Surbana Jurong Private Limited\Documents\GH\icon.png")
dk_b64_encode_icon_2 = DKB64EncodeIcon(File_path=file_path_5)
# Assigning Titleblock Type Parameter
# Assigning Sheet Name Parameter
# Assigning Sheet Number Parameter
# Adding Sheets to Revit Project
text_writer = TextWriter(WriteToggle=False)

# ----
# User Inputs
panel_23 = Panel("Header Tab")
panel_24 = Panel("""TAB 1
TAB 2
TAB 3""")
dk_header_tab = Panel("2")
dk_push_me_21 = Panel("False")
panel_25 = Panel("""DKUI Pull Down Menu

Select an item to change the state 
in the GH Script""")
dk_toggle_button = Panel("False")
dk_select_a_level = Panel("0")
panel_26 = Panel("""DKUI Button

Press here to change the state 
in the GH Script""")
dk_input_a_number_please = Panel("3")
panel_27 = Panel("""DKUI Number Input

Enter a number here to change the state 
in the GH Script""")
dk_check_the_box = Panel("True")
panel_28 = Panel("""DKUI Check Box

Check the box to change the state 
in the GH Script""")
panel_29 = Panel("""DKUI Toggle Button

Press on/press off here to change the state 
in the GH Script""")
dk_check_box = DKCheckBox(Name="Check the box", Value=dk_check_the_box, Tool_tip=panel_28)  # -> Check_box, Value
dk_button = DKButton(Name="Push Me!", Value=dk_push_me_21, Tool_tip=panel_26, Align="center")  # -> Button, Value
dk_pull_down_menu = DKPullDownMenu(Name="Select a Level", Values=panel, Value=dk_select_a_level, Tool_tip=panel_25)  # -> Pull_down, Value
dk_number_input = DKNumberInput(Name="Input a number please", Min_num="0", Max_num="100", Step="1", Value=dk_input_a_number_please, Tool_tip=panel_27)  # -> Number, Value
dk_toggle_button_2 = DKToggleButton(Name="Toggle Button", Label_f="RUN TASK", Label_t="STOP TASK", Value=dk_toggle_button, Tool_tip=panel_29, Align="center")  # -> Button, Value
dk_number_slider = DKNumberSlider(Name=<missing>, Min_num=<missing>, Max_num=<missing>, Step=<missing>, Value=<missing>, Tool_tip=<missing>)  # -> Slider, Value
button_value = Panel(dk_button.Value)
number_input_value = Panel(dk_number_input.Value)
pull_down_index = Panel(dk_pull_down_menu.Value)
toggle_value = Panel(dk_toggle_button_2.Value)
check_box_value = Panel(dk_check_box.Value)

dk_tab_control_2 = DKTabControl2(Name=panel_23, Tab_names=panel_24, Value=dk_header_tab, Show_header=Toggle(False))  # -> Tab_head, Value
merge_2 = Merge(Data1=dk_h2_text_2, Data2=dk_number_input.Number, Data3=dk_toggle_button_2.Button)
merge_3 = Merge(Data1=dk_h2_text_3, Data2=dk_button.Button, Data3=dk_button.Button)
filter = StreamFilter(Gate=dk_tab_control_2.Value, Stream0=merge, Stream1=merge_2, Stream2=merge_3)

merge_4 = Merge(Data1=dk_tab_control_2.Tab_head, Data2=filter)
page_number = Panel(dk_tab_control_2.Value)
html = Text(merge_4)

# ---- group: DKUI SERVER
# DKUI Server
dk_style_light = DKStyleLight()
dk_style_dark = DKStyleDark()
dk_scroll = Panel("0")
html_2 = Text(html)
item = ListItem(List=html_2, Index=0, Wrap=True)
dk_return_scroll_pos = DKReturnScrollPos(Scroll=dk_scroll)
dk_light_or_dark = DKLightOrDark(Trigger=item)
filter_2 = StreamFilter(Gate=dk_light_or_dark, Stream0=dk_style_light, Stream1=dk_style_dark)
toggle = BooleanToggle(False)

# ----
concatenate_3 = Concatenate(B=filter_2, Fragment_B=panel_22)

# ---- group: DKUI SERVER (continued)
dk_build_page = DKBuildPage(Css=concatenate_3, Js=dk_return_scroll_pos, Html=html_2)

# ----
dk_page_server = DKPageServer(Show=toggle, Title="RBG Test UI", Page=dk_build_page, Icon_file=dk_b64_encode_icon_2, Close_rhino=Toggle(False))

# ==== cluster Cluster
header_text = ClusterInput()  # HEADER TEXT
number = Number(26)
number_2 = Number(2)
colour = Colour(RGB(59, 216, 255))
number_3 = Number(26)
colour_2 = Colour(RGB(76, 76, 76))
file_path = FilePath("C:\Users\Harley.Trappitt\OneDrive - Surbana Jurong Private Limited\Documents\GH\icon.png")
create_text_block = CreateTextBlock(Text=header_text, TextSize=number, Justification="1")
create_separator = CreateSeparator(Thickness=number_3, Horizontal=True, Color=colour_2)
create_separator_2 = CreateSeparator(Thickness=number_2, Horizontal=True, Color=colour)
create_image = CreateImage(ImageSource=file_path, ImageWidth="50")
image_resource = ImageResource("C:\Users\Harley.Trappitt\OneDrive - Surbana Jurong Private Limited\Documents\GH\icon.png")
entwine = Entwine(
    Branch00=image_resource,
    Branch01=create_text_block,
    Branch02=create_separator_2,
    Branch03=create_separator,
    FlattenInputs=True)  # -> flatten(Result)
header_ui = ClusterOutput(entwine)  # HEADER UI
